# Grasshopper definition box-test-2.ghx (Grasshopper 1.0.7)
# plug-ins: Phio.Net.GH.Plugin

material = Input("blue-material", PackhuntParamSettings_Type="Text")
length = Input(Slider(250, range=0..1000), PackhuntParamSettings_Type="Generic")
width = Input(Slider(250, range=0..1000), PackhuntParamSettings_Type="Generic")
num = Number(length)
num_2 = Number(width)
cone = Cone(Base=PlaneXY(0, 0, 0), Radius=num_2, Length=num)  # -> Cone, Tip
cap = CapHoles(Brep=cone.Cone)
debrep = DeconstructBrep(Brep=cap)  # -> Faces, Edges, Vertices
tmatch = MatchText(Text=debrep.Faces, Pattern="Untrimmed Surface", Case=True)
dispatch = Dispatch(List=debrep.Faces, DispatchPattern=tmatch)  # -> ListA, ListB
volume = Volume(Geometry=cap)  # -> Volume, Centroid
panel = Panel(material)
panel_2 = Panel(material)
python = GhPythonScript(x=volume.Volume)  # -> out, a
# ---------- python: Python ----------
__author__ = "benja"
__version__ = "2022.08.16"

import rhinoscriptsyntax as rs

a = []

a.append(str(x) + "I did this in python")
# ---------- end python ----------
assign_material = AssignMaterial(Object=dispatch.ListA, Material=panel)
assign_material_2 = AssignMaterial(Object=dispatch.ListB, Material=panel_2)
txt = Text(python.a)
untrimmed_surface = Output(assign_material, PackhuntParamSettings_Type="Generic")
trimmed_surface = Output(assign_material_2, PackhuntParamSettings_Type="Generic")
volume_output = Output(txt, PackhuntParamSettings_Type="Generic")
