# Grasshopper definition box-test.ghx (Grasshopper 1.0.7)
# plug-ins: Phio.Net.GH.Plugin

length = Input(Slider(250, range=0..1000), PackhuntParamSettings_Type="Generic")
width = Input(Slider(250, range=0..1000), PackhuntParamSettings_Type="Generic")
num = Number(length)
num_2 = Number(width)
cone = Cone(Base=PlaneXY(0, 0, 0), Radius=num_2, Length=num)  # -> Cone, Tip
cap = CapHoles(Brep=cone.Cone)
debrep = DeconstructBrep(Brep=cap)  # -> Faces, Edges, Vertices
tmatch = MatchText(Text=debrep.Faces, Pattern="Untrimmed Surface", Case=True)
dispatch = Dispatch(List=debrep.Faces, DispatchPattern=tmatch)  # -> ListA, ListB
assign_material = AssignMaterial(Object=dispatch.ListA, Material="blue-material")
assign_material_2 = AssignMaterial(Object=dispatch.ListB, Material="blue-material")
untrimmed_surface = Output(assign_material, PackhuntParamSettings_Type="Generic")
trimmed_surface = Output(assign_material_2, PackhuntParamSettings_Type="Generic")
