# Grasshopper definition box.ghx (Grasshopper 1.0.7)
# plug-ins: Phio.Net.GH.Plugin

length = Input(Slider(250, range=0..1000), PackhuntParamSettings_Type="Generic")
width = Input(Slider(250, range=0..1000), PackhuntParamSettings_Type="Generic")
num = Number(length)
num_2 = Number(width)
rectangle = Rectangle(Plane=PlaneXY(0, 0, 0), XSize=num, YSize=num_2, Radius=0)  # -> Rectangle, Length
box_rectangle = BoxRectangle(Rectangle=rectangle.Rectangle, Height=Slider(250, range=0..5000))
debrep = DeconstructBrep(Brep=box_rectangle)  # -> Faces, Edges, Vertices
assign_material = AssignMaterial(Object=debrep.Faces, Material="blue-material")
box_output = Output(assign_material, PackhuntParamSettings_Type="Generic")
